# Dynamo graph Attaching foreign levels to levels in your revit file.dyn (Dynamo 3.6.1.9895)
# packages: Clockwork for Dynamo 3.x 3.3.0

# group: Script description
# Remmeber to UNFREEZE the end of the nodes
# note: Script Name: Missing Mark Checker
# Category: QC - Quality Control
# Author: CatBuilds
# Date: 26-05-2026
# Version: 1.0
# Description:
# How to use:
# 	1.	Open script in Dynamo Player or Dynamo
# 	2.	Run the script
# 	3.	Check the Output group for the Element IDs of doors with missing marks
# 	4.	Note the total count of missing marks
# 	5.	Go to Revit → Manage → Select by ID
# 	6.	Paste each ID to locate and fix the door manually
# Input: All doors in the active Revit project
# Output:
# 	•	List of door Element IDs with empty Mark values
# 	•	Total count of doors with missing marks
# Notes:
# 	•	Script only reports problems — it does not change anything in your model
# 	•	Can be adapted for Windows, Rooms or any other category by changing the Category input node
# 	•	Run the script again after fixing to confirm all marks are filled

# group: Finding Level: "L1" > Value L1
# Set the name of the item you want to find
string = StringInput("L2")
# note: Insert input(s)
string_2 = StringInput("L1")

# group: Scanning for all levels in project
# note: Insert input
categories = Categories("OST_Levels")
all_elements_of_category = ElementsOfCategory(Category=categories)

# group: Finding Level: "L1" > Names of levels in project
name = Element.Name(element=all_elements_of_category)

# group: Finding Level: "L1"
# Scanning for anything containing ''L1''. True = match
list_create = List.Create(item0=string_2)
contains = List.Contains(list=name, item=list_create, lacing=Longest)

# group: Filtering: ''L1'' -> in Rest -> out
filterByBoolMask = List.FilterByBoolMask(list=all_elements_of_category, mask=contains)

# group: Isolated info about the rest of the levels > List of all elements on level ''S1'', "S2" and ''L2''.
all_elements_at_level = ElementsAtLevel(Level=filterByBoolMask.out)

# group: Isolated info about the rest of the levels > Name of all elements on level ''S1'', "S2" and ''L2''.
name_2 = Element.Name(element=all_elements_at_level)

# group: Isolated info about Level "L1" > List of all elements on level ''L1''
# A list of all the elements that are set to this level.
all_elements_at_level_2 = ElementsAtLevel(Level=filterByBoolMask.in)

# group: Isolated info about the rest of the levels > Collapsing list into one.
flatten = List.Flatten(list=all_elements_at_level)

# group: Isolated info about the rest of the levels
# This is a list of the rest of the previous filtered list.
name_3 = Custom[Element.Name+](element=flatten)  # package Clockwork for Dynamo 3.x; Gets an element's name. Unlike the OOTB node, this node should work for *all* Revit elements that have names and will also return the localized names of system parameters, parameter groups, display unit types, parameter types, unit symbol types, unit types and ForgeTypeIds.

# group: Collecting elements on specific level whcich we want to relocate > Choose level by name
# note: Insert input
string_3 = StringInput("S1")

# group: Collecting elements on specific level whcich we want to relocate
list_create_2 = List.Create(item0=string_3)

# group: Collecting elements on specific level whcich we want to relocate > Scanning for elements on ''S1''
contains_2 = List.Contains(list=flatten, item=list_create_2, lacing=Longest)

# group: Collecting elements on specific level whcich we want to relocate > Collecting elemets on level "S1"
# Catching all the elements that contains S1
boolean = BoolSelector(true)
eq = contains_2 == boolean

# group: Collecting elements on specific level whcich we want to relocate > Filtering elements on level ''S1'' into in (output)
filterByBoolMask_2 = List.FilterByBoolMask(list=flatten, mask=eq)  # frozen

# group: Actively changing the walls from "S1" to "L1". > Parameter name
# Changing values in this specific parameter
# note: Insert input
string_4 = StringInput("Base Constraint")

# group: Isolated info about Level "L1" > Choose index nr.
number = DoubleInput(0)

# group: Isolated info about Level "L1" > Catching index "0" to catch specific level as Revit object
# note: Insert input
getItemAtIndex = List.GetItemAtIndex(list=filterByBoolMask.in, index=number, lacing=Longest)

# group: Actively changing the walls from "S1" to "L1". > Setting new values in chosen parameter
setParameterByName = Element.SetParameterByName(element=filterByBoolMask_2.out, parameterName=string_4, value=getItemAtIndex, lacing=Longest)

# group: Remember UI
watch = Watch(setParameterByName)
