# Dynamo graph Missing Mark Checker.dyn (Dynamo 3.6.1.9895)
# packages: archi-lab.net 2025.300.1225, Clockwork for Dynamo 3.x 3.3.0

# group: Note description
# note: Script Name: Missing Mark Checker
# Category: QC - Quality Control
# Author: Catrqu
# Date: 16-05-2026
# Version: 1.0
# Description:
# This script scans all doors in the active Revit project and identifies any doors where the Mark parameter is completely empty. Empty marks cause missing information in schedules, tags and construction documents and are difficult to spot manually in large projects.
# How to use:
# 	1.	Open script in Dynamo Player or Dynamo
# 	2.	Run the script
# 	3.	Check the Output group for the Element IDs of doors with missing marks
# 	4.	Note the total count of missing marks
# 	5.	Go to Revit → Manage → Select by ID
# 	6.	Paste each ID to locate and fix the door manually
# Input: All doors in the active Revit project
# Output:
# 	•	List of door Element IDs with empty Mark values
# 	•	Total count of doors with missing marks
# Notes:
# 	•	Script only reports problems — it does not change anything in your model
# 	•	Can be adapted for Windows, Rooms or any other category by changing the Category input node
# 	•	Run the script again after fixing to confirm all marks are filled

# group: Selecting all doors in the project
categories = Categories("OST_Doors")
all_elements_of_category = ElementsOfCategory(Category=categories)

# group: Finding values from parameter Mark
string = StringInput("Mark")
getParameterValueByName = Element.GetParameterValueByName(element=all_elements_of_category, parameterName=string)

# group: Showing null or emties as ''true''
isNullOrEmpty = archilab.Core.Strings.IsNullOrEmpty(str=getParameterValueByName)

# group: Listing specific doors and element ID's (insert in Revit)
filterByBoolMask = List.FilterByBoolMask(list=all_elements_of_category, mask=isNullOrEmpty)
ID = Custom[Element.ID+](element=filterByBoolMask.in)  # package Clockwork for Dynamo 3.x; Gets the ID of a given Revit elements. Unlike the OOTB Element.Id node, this node also works on mixed lists of Revit elements and categories.

countTrue = List.CountTrue(list=isNullOrEmpty)
