# Dynamo graph Check amount of missing values on room Parameters.dyn (Dynamo 3.6.1.9895)

# group: Scanning project for rooms
# note: Insert input
categories = Categories("OST_Rooms")
all_elements_of_category = ElementsOfCategory(Category=categories)

# group: Getting value from parameter: "BuildingID". > Set Parameter
# note: Insert Input
string = StringInput("BuildingID")

# group: Getting value from parameter: "BuildingID". > Values from parameter
getParameterValueByName = Element.GetParameterValueByName(element=all_elements_of_category, parameterName=string)

# group: Getting value from parameter: "Level". > Set Parameter
# note: Insert Input
string_2 = StringInput("Level")

# group: Getting value from parameter: "Level". > Values from parameter
getParameterValueByName_2 = Element.GetParameterValueByName(element=all_elements_of_category, parameterName=string_2)

# group: Getting value from parameter: "Number". > Set Parameter
# note: Insert Input
string_3 = StringInput("Number")

# group: Getting value from parameter: "Number". > Values from parameter
getParameterValueByName_3 = Element.GetParameterValueByName(element=all_elements_of_category, parameterName=string_3)

# group: Getting value from parameter: "CCS-Classification". > Set Parameter
# note: Insert Input
string_4 = StringInput("CCS-Classification")

# group: Getting value from parameter: "CCS-Classification". > Values from parameter
getParameterValueByName_4 = Element.GetParameterValueByName(element=all_elements_of_category, parameterName=string_4)

# group: Getting value from parameter: "CCS-Classification". > Set Parameter
# note: Insert Input
string_5 = StringInput("Floor Finish")

# group: Getting value from parameter: "CCS-Classification". > Values from parameter
getParameterValueByName_5 = Element.GetParameterValueByName(element=all_elements_of_category, parameterName=string_5)

# group: Getting value from parameter: "CCS-Classification". > Set Parameter
# note: Insert Input
string_6 = StringInput("Occupant")

# group: Getting value from parameter: "CCS-Classification". > Values from parameter
getParameterValueByName_6 = Element.GetParameterValueByName(element=all_elements_of_category, parameterName=string_6)

# group: From 6 different lists to list trasnpose > Cerating lists of all outputs from values
list_create = List.Create(item0=getParameterValueByName, item1=getParameterValueByName_2, item2=getParameterValueByName_3, item3=getParameterValueByName_4, item4=getParameterValueByName_5, item5=getParameterValueByName_6)

# group: From 6 different lists to list trasnpose > From 5 different lists to a transposed list
transpose = List.Transpose(lists=list_create)

# group: Finding finding values of " ". (The ones that are missing values) > Search for...
# note: Insert Input
string_7 = StringInput("")

# group: Finding finding values of " ". (The ones that are missing values) > True equals: yes, missing value
eq = transpose == string_7

# group: Finding finding values of " ". (The ones that are missing values) > Total amount of missing values in parameters
countTrue = List.CountTrue(list=eq)
