# Dynamo graph Finding missing parameters for rooms - write to excel.dyn "Scxreaning parameters for rooms - wrtie to excel" (Dynamo 3.6.1.9895)

# group: Scanning project for 'Rooms'
# note: Finding information about which specific rooms thats missing the data in the parameter ''BuildingID''.
# note: Insert input
categories = Categories("OST_Rooms")
all_elements_of_category = ElementsOfCategory(Category=categories)

# group: Parameter name
# note: Insert input
string = StringInput("BuildingID")

# group: Getting values from parameter
getParameterValueByName = Element.GetParameterValueByName(element=all_elements_of_category, parameterName=string)

# group: Search for value:
# note: Insert input
string_2 = StringInput("")

# group: If value equals search for = true
eq = getParameterValueByName == string_2

# group: Filtering true and false
filterByBoolMask = List.FilterByBoolMask(list=all_elements_of_category, mask=eq)

# group: RoomID for rooms missing value in parameter: BuildingID
watch = Watch(filterByBoolMask.in)

file_path = Filename(".\Dynamo - LDN.xlsx")
string_3 = StringInput("Missing BuildingID")
number = DoubleInput(5)
number_2 = DoubleInput(3)
boolean = BoolSelector(false)
openXMLExportExcel = Data.OpenXMLExportExcel(filePath=file_path, sheetName=string_3, startRow=number, startColumn=number_2, overWrite=boolean)  # unwired: data

# group: Amount of rooms missing value in parameter: BuildingID
count = List.Count(list=filterByBoolMask.in)

list_create = List.Create(item0=count)
file_path_2 = Filename(".\Dynamo - LDN.xlsx")
string_4 = StringInput("Missing BuildingID")
number_3 = DoubleInput(11)
number_4 = DoubleInput(1)
openXMLExportExcel_2 = Data.OpenXMLExportExcel(filePath=file_path_2, sheetName=string_4, startRow=number_3, startColumn=number_4)  # unwired: data
id = Element.Id(element=filterByBoolMask.in)
list_create_2 = List.Create(item0=id)
transpose = List.Transpose(lists=list_create_2)
string_5 = StringInput("Level")
getParameterValueByName_2 = Element.GetParameterValueByName(element=filterByBoolMask.in, parameterName=string_5)
list_create_3 = List.Create(item0=getParameterValueByName_2)
transpose_2 = List.Transpose(lists=list_create_3)
file_path_3 = Filename(".\Dynamo - LDN.xlsx")
string_6 = StringInput("Missing BuildingID")
number_5 = DoubleInput(11)
number_6 = DoubleInput(3)
openXMLExportExcel_3 = Data.OpenXMLExportExcel(filePath=file_path_3, sheetName=string_6, startRow=number_5, startColumn=number_6)  # unwired: data
string_7 = StringInput("Number")
getParameterValueByName_3 = Element.GetParameterValueByName(element=filterByBoolMask.in, parameterName=string_7)
list_create_4 = List.Create(item0=getParameterValueByName_3)
transpose_3 = List.Transpose(lists=list_create_4)
file_path_4 = Filename(".\Dynamo - LDN.xlsx")
string_8 = StringInput("Missing BuildingID")
number_7 = DoubleInput(11)
number_8 = DoubleInput(4)
openXMLExportExcel_4 = Data.OpenXMLExportExcel(filePath=file_path_4, sheetName=string_8, startRow=number_7, startColumn=number_8)  # unwired: data
string_9 = StringInput("CCS-Classification")
getParameterValueByName_4 = Element.GetParameterValueByName(element=filterByBoolMask.in, parameterName=string_9)
list_create_5 = List.Create(item0=getParameterValueByName_4)
transpose_4 = List.Transpose(lists=list_create_5)
file_path_5 = Filename(".\Dynamo - LDN.xlsx")
string_10 = StringInput("Missing BuildingID")
number_9 = DoubleInput(11)
number_10 = DoubleInput(5)
openXMLExportExcel_5 = Data.OpenXMLExportExcel(filePath=file_path_5, sheetName=string_10, startRow=number_9, startColumn=number_10)  # unwired: data
string_11 = StringInput("Floor Finish")
getParameterValueByName_5 = Element.GetParameterValueByName(element=filterByBoolMask.in, parameterName=string_11)
list_create_6 = List.Create(item0=getParameterValueByName_5)
transpose_5 = List.Transpose(lists=list_create_6)
file_path_6 = Filename(".\Dynamo - LDN.xlsx")
string_12 = StringInput("Missing BuildingID")
number_11 = DoubleInput(11)
number_12 = DoubleInput(5)
openXMLExportExcel_6 = Data.OpenXMLExportExcel(filePath=file_path_6, sheetName=string_12, startRow=number_11, startColumn=number_12)  # unwired: data
