# Dynamo graph Not Enclosed Rooms Checker.dyn (Dynamo 3.6.1.9895)

# group: Finding all rooms in the project
categories = Categories("OST_Rooms")
all_elements_of_category = ElementsOfCategory(Category=categories)

# group: Rooms with no locations
getLocation = Element.GetLocation(element=all_elements_of_category)
isNull = Object.IsNull(object=getLocation)

not_ = Not(x=isNull)

# group: Rooms with no area
string = StringInput("Area")
getParameterValueByName = Element.GetParameterValueByName(element=all_elements_of_category, parameterName=string)

string_2 = StringInput("")
eq = getParameterValueByName == string_2
and_ = And(bool0=not_, bool1=eq)
boolean = BoolSelector(true)
eq_2 = and_ == boolean
filterByBoolMask = List.FilterByBoolMask(list=all_elements_of_category, mask=eq_2)

# group: List of rooms with no/null area. Not enclosed rooms:
name = Element.Name(element=filterByBoolMask.in)

# group: List of rooms either placed or not enclosed.
name_2 = Element.Name(element=filterByBoolMask.out)
