# Dynamo graph Unplaced Rooms Checker.dyn (Dynamo 3.6.1.9895)

# group: Finding all rooms in the project
categories = Categories("OST_Rooms")
all_elements_of_category = ElementsOfCategory(Category=categories)

# group: Get locations on rooms and returning true to null
getLocation = Element.GetLocation(element=all_elements_of_category)
isNull = Object.IsNull(object=getLocation)

filterByBoolMask = List.FilterByBoolMask(list=all_elements_of_category, mask=isNull)

# group: List of rooms with no/null locations. Unplaced rooms:
name = Element.Name(element=filterByBoolMask.in)

# group: List of rooms either placed or not enclosed.
name_2 = Element.Name(element=filterByBoolMask.out)
