# Dynamo graph Replace part of values in room number - based on parameter BuildingID.dyn (Dynamo 4.0.2.3852)

# group: Script description
# note: Note description
# Script Name: Replace part of room number
# Category: Write to Revit
# Author: CatBuilds
# Date: 21.09.2026
# Version: 1.0
# Description:
# This script scans all rooms in the active Revit project and identifies any rooms with a specific p
# arameter, BuikdingID. In this case we look at rooms with value B2. However it scans for room numbers containing "01.ST" and replace the "01" with "02".

# group: Scanning for all rooms in project
# note: Inser input
categories = Categories("OST_Rooms")
all_elements_of_category = ElementsOfCategory(Category=categories)

# group: Finding rooms with value "B2" in parameter "BuildingID" > Parameter name
# note: Inser input
string = StringInput("BuildingID")

# group: Finding rooms with value "B2" in parameter "BuildingID" > Getting values of the parameter
getParameterValueByName = Element.GetParameterValueByName(element=all_elements_of_category, parameterName=string)

string_2 = StringInput("B2")
eq = getParameterValueByName == string_2

# group: Filtering "B2" -> in Rest -> out
filterByBoolMask = List.FilterByBoolMask(list=all_elements_of_category, mask=eq)

# group: Finding rooms with previous value B2 and values in the parameter "Number". > Parameter name
string_3 = StringInput("Number")

# group: Finding rooms with previous value B2 and values in the parameter "Number".
getParameterValueByName_2 = Element.GetParameterValueByName(element=filterByBoolMask.in, parameterName=string_3)

# group: Scanninf for numbers starting with "01.ST" and filtering them. > Parameter value
string_4 = StringInput("01.ST")

# group: Scanninf for numbers starting with "01.ST" and filtering them.
contains = String.Contains(string=getParameterValueByName_2, searchFor=string_4)
boolean = BoolSelector(true)
eq_2 = contains == boolean

# group: Filtering: Rooms with value "B2" in parameter "buildingID" + Rooms containing "01.ST" in parameter "Number"
filterByBoolMask_2 = List.FilterByBoolMask(list=getParameterValueByName_2, mask=eq_2)

# group: Search for value and replace it with...
string_5 = StringInput("01.ST.")
string_6 = StringInput("02.ST.")

# group: Set/replace new values in the parameter "Number"
string_7 = StringInput("Number")
replace = String.Replace(string=filterByBoolMask_2.in, searchFor=string_5, replaceWith=string_6)
setParameterByName = Element.SetParameterByName(element=filterByBoolMask.in, parameterName=string_7, value=replace)
